# Grasshopper definition BrepTest.ghx (Grasshopper 1.0.7)
# plug-ins: Speckle 2

number_slider = Slider(3, range=0..10)
range = Range(Domain=Domain(0, 1), Steps=number_slider)
pt = Point(Point(0.857159852, 0.8096784471, -0.4874729231))
pt_2 = ConstructPoint(XCoordinate=graft(range), YCoordinate=range, ZCoordinate=0)
cyl = Cylinder(Base=pt, Radius=0.5, Length=1)
srfgrid = SurfaceFromPoints(Points=flatten(pt_2), UCount=expr("x+1", number_slider), Interpolate=False)
cap = CapHoles(Brep=cyl)
trim = TrimSolid(Shape=srfgrid, Cutters=cap)
to_speckle = ToSpeckle(Objects=trim, KitName="Objects")
to_native = ToNative(Objects=to_speckle, KitName="Objects")
to_speckle_2 = ToSpeckle(Objects=srfgrid, KitName="Objects")
brep = Brep(to_native)
panel = Panel(to_speckle_2)
edges = BrepEdges(Brep=brep)  # -> Naked, Interior, NonManifold
panel_2 = Panel(brep)
item = ListItem(List=edges.Naked, Index=Slider(0, range=0..4), Wrap=True)
