# Grasshopper definition ExtendObjectTest.ghx (Grasshopper 1.0.7)
# plug-ins: Speckle 2

list = Accounts(
    {"Account (alan@rynne.es | http://localhost:3000)": "c17e3b5af2f177869a733cca10850355"}, selected="Account (alan@rynne.es | http://localhost:3000)",
    selectedId="c17e3b5af2f177869a733cca10850355",
    selectedServer="http://localhost:3000")
sph = Sphere(Base=PlaneXY(0, 0, 0), Radius=1)
repeat = RepeatData(Data=sph, Length=Slider(100, range=0..100))
panel = Panel("""ABBC
BCDE""")
cso = CreateSpeckleObject(A="/Original", B="/Original", C="/Original")  # -> Debug, SpeckleObject
entwine = Entwine(Branch00=repeat, FlattenInputs=True)
id_9abc86882e = CreateStream(Account=list, stream="9abc86882e http://localhost:3000 c17e3b5af2f177869a733cca10850355")
create_object_by_key_value = CreateObjectByKeyValue(Keys=panel, Values=entwine)
eso = ExtendSpeckleObject(SpeckleObject=cso.SpeckleObject, Keys=panel, Values=entwine)
send = Send(
    Data=eso,
    Stream=id_9abc86882e,
    Branch="main",
    AutoSend=False,
    BaseId="6ccf28c9529a7487a74db898f7ee153d",
    CurrentComponentState="up_to_date",
    OutputWrappers="http://localhost:3000\t9abc86882e\t8493b0e21d",
    UseDefaultCache=True)  # -> Commits, ObjectId, Data
pt = Point("asdfasd")
receive = Receive(
    ID=send.Commits,
    AutoReceive=False,
    CurrentComponentState="up_to_date",
    LastInfoMessage="Alan Rynne @ 2020-10-23T13:02:37.045Z: Grasshopper push. (id:8493b0e21d)",
    ReceivedObjectId="6ccf28c9529a7487a74db898f7ee153d",
    StreamWrapper="http://localhost:3000/streams/9abc86882e/commits/8493b0e21d?u=c17e3b5af2f177869a733cca10850355")  # -> Data, Info
sb = SpeckleBase(graft(receive.Info))
eso_2 = ExpandSpeckleObject(SpeckleObject=[receive.Info, receive.Data])  # -> A, B, C, ABBC
panel_2 = Panel(eso_2.ABBC)
